# Dynamo graph Export to OBJ_STL_DAE_PLY.dyn "Export to OBJ" (Dynamo 2.6.1.8786)
# packages: MeshToolkit 3.0.0, archi-lab.net 2021.25.21, GenerativeDesign.Revit 1.3.1

file_path = Filename("..\..\..\..\Documents\export_.stl")
code_block = CodeBlock { ".stl"; ".obj"; ".dae"; ".ply"; }
list_create = List.Create(item0=code_block.out0, item1=code_block.out1, item2=code_block.out2, item3=code_block.out3)
dropdown_list_selector = DropdownListSelector(List=list_create, ItemsCollection=[{Name: ".stl", Index: 0, IsSelected: true}, {Name: ".obj", Index: 1, IsSelected: false}, {Name: ".dae", Index: 2, IsSelected: false}, {Name: ".ply", Index: 3, IsSelected: false}])  # graph output
add = file_path + dropdown_list_selector
fileName = FileSystem.FileName(path=add, withExtension=dropdown_list_selector)
all_elements_in_active_view = ElementsInView()
dropdown_list_selector_2 = DropdownListSelector(List=all_elements_in_active_view)  # graph output
solids = Element.Solids(element=dropdown_list_selector_2)
flatten = List.Flatten(list=solids)
byUnion = Solid.ByUnion(solids=flatten)
byGeometry = Autodesk.Dynamo.MeshToolkit.Mesh.ByGeometry(inputGeometry=byUnion)
exportMeshes = Autodesk.Dynamo.MeshToolkit.Mesh.ExportMeshes(filename=fileName, meshes=byGeometry)
drag_select_wall_elements = DSModelDragWallSelection()  # 4 picked in the model
dropdown_list_selector_3 = DropdownListSelector()  # graph output; unwired: List
