# Dynamo graph Export to OBJ_STL_DAE_PLY.dyn (Dynamo 2.6.1.8786)
# packages: MeshToolkit 3.0.0, archi-lab.net 2021.25.21

file_path = Filename("..\..\..\..\..\Documents\ExportNEW")  # graph input; graph output
type_in_file_type_obj_stl_dae_or = StringInput(".obj")  # "Type in file type (.obj, .stl, .dae or .ply)"; graph input
add = file_path + type_in_file_type_obj_stl_dae_or
fileName = FileSystem.FileName(path=add, withExtension=type_in_file_type_obj_stl_dae_or)
all_elements_in_active_view = ElementsInView()
dropdown_list_selector = DropdownListSelector(List=all_elements_in_active_view)
solids = Element.Solids(element=dropdown_list_selector)
flatten = List.Flatten(list=solids)
byUnion = Solid.ByUnion(solids=flatten)
byGeometry = Autodesk.Dynamo.MeshToolkit.Mesh.ByGeometry(inputGeometry=byUnion)
exportMeshes = Autodesk.Dynamo.MeshToolkit.Mesh.ExportMeshes(filename=fileName, meshes=byGeometry)
